test file "AEBScenarioVariationTest"

suite "Test Scenario"

  case "AEB_Car_To_Pedestrian_Nearside_Child" [simulation]
    model AEBTestBench
    cleanup callback:
      helperPlotAEBResults(sltest_simout.logsout)
    iteration script:
      % Define ego new speeds
      egoNewSpeeds = [50 45 40 35 30 25 20 15 10]/3.6; % 1 m/s = 3.6 km/hr

      % Define new collision points
      newCollisionPoints = [0.2 0.3 0.5 0.7];

      % Save the new speeds and collision points to base workspace for post
      % simulation analysis.
      assignin('base', 'egoNewSpeeds', egoNewSpeeds);
      assignin('base', 'newCollisionPoints', newCollisionPoints);

      % Determine the number of possible iterations
      numEgoSpeeds = length(egoNewSpeeds);
      numCollisionPoints = length(newCollisionPoints);

      % Create the seed scenario
      [seedScenario, egoVehicle] = helperCreateSeedScenario();

      % Get the scenario descriptor from the seed scenario
      scenarioDescriptor = getScenarioDescriptor(seedScenario,Simulator="DrivingScenario");

      % Run the setup script to initialize the workspace variable, and buses that
      % are required to run the AEBTestBench.slx
      helperSLAEBSetup("scenarioFcnName","scenario_AEB_CPNC_Variant");

      % Ego Id
      egoID =  egoVehicle.ActorID;

      % Set target Id
      targetID = 2;

      % Validate seed scenario
      checkStatus = helperCheckScenario(egoID, targetID, scenarioDescriptor);
      if ~checkStatus % if scenario check failed, modify the scenario according to requirements
          scenarioDescriptor = helperPerformScenarioCollision(egoID, targetID, scenarioDescriptor, method = "WaitTime");
      end

      % Sweep over the ego new speeds and collision points to create Simulink
      % test iterations.
      for i = 1: length(egoNewSpeeds) % Select the ego new speed to vary over the new collision points
          for j = 1 : length(newCollisionPoints) % Select the collision point to vary for the current iteration

              % Generate the current scenario with the current ego speed,
              % collision point information.
              scenarioVariant = helperGenerateScenarioVariant(scenarioDescriptor, egoID, targetID, egoNewSpeeds(i), newCollisionPoints(j));

              % Calculate the egoVehDyn structure that is required to update the
              % initial ego speed for the AEBTestBenBench.
              egoVehDyn = helperGetEgoVehicleDynamicsParams(scenarioVariant, egoID);

              % Create the test iteration object.
              testItr = sltest.testmanager.TestIteration;

              % Set the scenario variable with the scenarioVariant for the current iteration.
              testItr.setVariable('Name', 'scenario', 'Source', 'model workspace', 'Value', scenarioVariant);

              % Set the ego vehicle set speed v_set variable for the current iteration.
              testItr.setVariable('Name', 'v_set', 'Source', 'base workspace', 'Value', egoNewSpeeds(i));

              % Set the egoVehDyn structure for the current iteration.
              testItr.setVariable('Name', 'egoVehDyn', 'Source', 'base workspace', 'Value', egoVehDyn);

              testItrName = sprintf('Speed_%dkmph_CollisionPoint_%d', uint8(egoNewSpeeds(i) * 3.6), uint8(newCollisionPoints(j)*100));

              % Add the current iteration
              addIteration(sltest_testCase, testItr, testItrName);
          end
      end